# Grasshopper definition 25 27 11 (nadja).gh (Grasshopper 1.0.8)

# first test one row
number_slider = Slider(5, range=0..10)
pt = Point("{0,0,0}")
line_1 = Curve(<curve referenced from the Rhino model>)  # disabled
py3 = Python3Script()  # -> out, a
# ---------- py3: Python ----------
# r: compas>=2.14.1
# venv: sticks

import sys
import os
import math

#get current file path
path = ghenv.Component.OnPingDocument().FilePath
print (path)
#get parent directory of the parent directory
parentdir = os.path.dirname(path)
print (parentdir)
#get src folder which contains classes
dire = os.path.join(parentdir,'scripts')
print (dire)

sys.path.append(dire)

from compas_rhino import unload_modules

unload_modules("Sticks")
unload_modules("stick_module")

import Sticks
from Sticks import Stick 
from stick_module import BranchingModule
from compas.geometry import Line, Point, Vector, Frame
# ---------- end py3 ----------
panel = Panel(".2")  # disabled
py3_2 = Python3Script(root_point=pt, x_range=number_slider)  # -> out, sticks, my_points, polylines; inputs root_point: Point3d, x_range: Int32
# ---------- py3_2: Python ----------
#locate stick class file in the same folder
from compas_rhino import unload_modules
import sys
import os
import math

#get current file path
path = ghenv.Component.OnPingDocument().FilePath
print(path)
#get parent directory of the parent directory
parentdir = os.path.dirname(path)
print(parentdir)
#get src folder which contains classes
dire = os.path.join(parentdir,'scripts')
print(dire)

sys.path.append(dire)


unload_modules('Sticks')
unload_modules('OrtogonalModule')
unload_modules('nadja_test')


import Sticks
import nadja_test
from Sticks import Stick, stick_bridge
from OrtogonalModule import OStickModule
from compas.geometry import Line, Point, Vector, Polyline
from compas_rhino.conversions import line_to_compas
from ghpythonlib.treehelpers import list_to_tree, tree_to_list

stick_length = 2
stick_width = .13
stick_depth = .13

points = []
assembly = []

for z in range(z_range):
    row = []
    for x in range(x_range):
        grid_size_x = stick_length - 2*stick_depth + offset_x
        grid_size = stick_length - 2*stick_depth
        grid_size_z = stick_length - 2*stick_depth + offset_y
        pt = Point(x * grid_size_x, grid_size, z * grid_size_z)
        row.append(pt)
    points.append(row)




### make this like it is a class
### function of the class: to planarize all the points 
pol_pt = []
polylines = []

for i in range(z_range-1):
    i = i % z_range
    pol_points = []
    for j in range(x_range-1):
        j = j % x_range
        p0 = points[i][j]
        p1 = points[i][j+1]
        p3 = points[i+1][j]
        p2 = points[i+1][j+1]
        pol_points.append([p0, p1, p2, p3, p0])
    
    pol_pt.append(pol_points)

for p_list in pol_pt:
    for p in p_list:
        pol = Polyline(p)
        polylines.append(pol)


my_points = list_to_tree(points)


# sticks = [s.geometry for s in assembly]
# ---------- end py3_2 ----------
crv = Curve([<curve referenced from the Rhino model> x16])
crv_2 = Curve([<curve referenced from the Rhino model> x16])  # disabled
line_0 = Curve(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)  # disabled
crv_3 = Curve([<curve referenced from the Rhino model> x4])  # disabled
crv_4 = Curve([<curve referenced from the Rhino model> x38])
cpoly = ControlPolygon(Curve=crv)  # -> Polygon, Points
cpoly_2 = ControlPolygon(Curve=crv_2)  # -> Polygon, Points; disabled
py3_3 = Python3Script(lines=crv)  # -> out, my_points, planes, projected_crvs, centroids, my_vectors; inputs lines: list of Polyline
# ---------- py3_3: Python ----------
#locate stick class file in the same folder
from compas_rhino import unload_modules
import sys
import os
import math

import Rhino.Geometry as rg
from ghpythonlib.treehelpers import list_to_tree, tree_to_list
# ---------- end py3_3 ----------
py3_4 = Python3Script(line_0=line_0, line_1=line_1, lines=crv_3, width=panel, depth=panel)  # -> out, stick_box, sticks; inputs line_0: Line, line_1: Line, lines: list of Line, width: Double, depth: Double; disabled
# ---------- py3_4: Python ----------
#locate stick class file in the same folder
from compas_rhino import unload_modules
import sys
import os
import math

#get current file path
path = ghenv.Component.OnPingDocument().FilePath
#get parent directory of the parent directory
parentdir = os.path.dirname(path)
#get src folder which contains classes
dire = os.path.join(parentdir,'sticks')

sys.path.append(dire)


unload_modules('Sticks')

import Sticks
from Sticks import Stick, stick_bridge
from compas.geometry import Line, Point, Vector
from compas_rhino.conversions import line_to_compas

assembly = []
line0 = line_to_compas(line_0)

#initiates a class Stick named stick0
stick0 = Stick(line0)
# stick0.rotate_stick(0)
assembly.append(stick0)

line1 = line_to_compas(line_1)
stick1 = Stick(line1)
# stick1.rotate_stick(0, Vector(0,1,0), stick1.axis.start)
assembly.append(stick1)


stick2 = stick_bridge(stick0, stick1)
assembly.append(stick2)


for line in lines:
    compas_line = line_to_compas(line)
    stick = Stick(compas_line, width, depth)
    assembly.append(stick)


# generates geometry of the stick0 class: Box
sticks = [s.geometry for s in assembly]
# ---------- end py3_4 ----------
py3_5 = Python3Script(lines=crv_4, width=".2", depth=".2")  # -> out, stick_box, sticks; inputs lines: list of Line, width: Double, depth: Double
# ---------- py3_5: Python ----------
#locate stick class file in the same folder
from compas_rhino import unload_modules
import sys
import os
import math

#get current file path
path = ghenv.Component.OnPingDocument().FilePath
#get parent directory of the parent directory
parentdir = os.path.dirname(path)
#get src folder which contains classes
dire = os.path.join(parentdir,'sticks')

sys.path.append(dire)


unload_modules('Sticks')

import Sticks
from Sticks import Stick, stick_bridge
from compas.geometry import Line, Point, Vector
from compas_rhino.conversions import line_to_compas

assembly = []

for line in lines:
    compas_line = line_to_compas(line)
    stick = Stick(compas_line, width=width, depth=depth)
    assembly.append(stick)


# generates geometry of the stick0 class: Box
sticks = [s.geometry for s in assembly]
# ---------- end py3_5 ----------
py3_6 = Python3Script(lines=crv_2)  # -> out, my_points, planes, projected_crvs, centroids, my_vectors; inputs lines: list of Polyline; disabled
# ---------- py3_6: Python ----------
#locate stick class file in the same folder
from compas_rhino import unload_modules
import sys
import os
import math

import Rhino.Geometry as rg
from ghpythonlib.treehelpers import list_to_tree, tree_to_list


constrol_pts = []
for crv in lines:
    points = []
    for i in range(len(crv) - 1):
        points.append(crv[i])
    constrol_pts.append(points)

# rearange the points
planes = []
projected_crvs = []
centroids = []
vectors = []
for pts, pl in zip(constrol_pts, lines):
    if len(pts) > 2:
        vector_list = []
        plane = rg.Plane(pts[0], pts[1], pts[2])
        plane_normal = plane.Normal

        plc = rg.PolylineCurve(pl)
        crv = plc.ToNurbsCurve()
        projected_crv = crv.ProjectToPlane(crv, plane)

        # test: try to project along vector
        # pl = crv.ToPolyline(0.01, 0.01, 0, 0)
        # pl = rg.PolylineCurve(plc)
        # poly = rg.Polyline()
        # polyline = pl.TryGetPolyline()
        # print(polyline)
        # for pt in pl:
        #     print(pt)
        
        # rearenge pts in order
        mp = rg.AreaMassProperties.Compute(projected_crv, 0.1)
        if mp:
            centroid = mp.Centroid
            center_plane = rg.Plane(centroid, plane.XAxis, plane.YAxis)
            # angle between the vector
            for pt in pl:
                A = centroid
                B = pt
                v1 = rg.Vector3d(A)
                v2 = rg.Vector3d(B)
                vector = v1 - v2
                vector_list.append(vector)

        centroids.append(centroid)
        planes.append(center_plane)
        vectors.append(vector_list)
        projected_crvs.append(projected_crv)
    else:
        pass



my_points = list_to_tree(constrol_pts)
my_vectors = list_to_tree(vectors)
# ---------- end py3_6 ----------
number_slider_2 = Slider(2, range=0..100)  # disabled
number_slider_3 = Slider(2, range=0..100)  # disabled
number_slider_4 = Slider(5, range=0..10)  # disabled
number_slider_5 = Slider(5, range=0..10)  # disabled
number_slider_6 = Slider(5, range=0..10)  # disabled
draw = COMPASDraw(cg=py3_2.sticks)  # -> rg
#   port cg: The COMPAS geometry or datastructure to be drawn.
#   port rg: The Rhino geometry object.
# ---------- draw: Python ----------
# r: compas>=2.14.1
"""
Draws COMPAS geometry in Grasshopper.
"""

from typing import Any

import Grasshopper

from compas.scene import SceneObject


class CompasToRhinoGeometry(Grasshopper.Kernel.GH_ScriptInstance):
    def RunScript(self, cg):
        if not cg:
            return None

        return SceneObject(item=cg).draw()
# ---------- end draw ----------
draw_2 = COMPASDraw(cg=py3_2.my_points)  # -> rg; same code as draw
draw_3 = COMPASDraw(cg=py3_4.sticks)  # -> rg; disabled; same code as draw
draw_4 = COMPASDraw(cg=py3_5.sticks)  # -> rg; same code as draw
crv_5 = Curve(py3_3.projected_crvs)
draw_5 = COMPASDraw(cg=py3_2.polylines)  # -> rg; same code as draw
crv_6 = Curve(py3_6.projected_crvs)  # disabled
points = PointList(Points=draw_2, Size="1")
swatch = ColourSwatch(SwatchColor=RGB(255, 255, 255))
pln = Plane(py3_3.planes)
panel_2 = Panel("1")  # disabled
pln_2 = Plane(py3_6.planes)  # disabled
py3_7 = Python3Script(
    x_range=number_slider_5,
    y_range=number_slider_4,
    z_range=number_slider_6,
    offset_x=number_slider_2,
    offset_y=number_slider_3)  # -> out, sticks, my_points, polylines; inputs x_range: Int32, y_range: Int32, z_range: Int32, offset_x: Double, offset_y: Double; disabled
# ---------- py3_7: Python ----------
#locate stick class file in the same folder
from compas_rhino import unload_modules
import sys
import os
import math

#get current file path
path = ghenv.Component.OnPingDocument().FilePath
#get parent directory of the parent directory
parentdir = os.path.dirname(path)
#get src folder which contains classes
dire = os.path.join(parentdir,'sticks')

sys.path.append(dire)


unload_modules('Sticks')
unload_modules('OrtogonalModule')

import Sticks
from Sticks import Stick, stick_bridge
from OrtogonalModule import OStickModule
from compas.geometry import Line, Point, Vector, Polyline
from compas_rhino.conversions import line_to_compas
from ghpythonlib.treehelpers import list_to_tree, tree_to_list

stick_length = 2
stick_width = .13
stick_depth = .13

points = []
assembly = []

for z in range(z_range):
    row = []
    for x in range(x_range):
        grid_size_x = stick_length - 2*stick_depth + offset_x
        grid_size = stick_length - 2*stick_depth
        grid_size_z = stick_length - 2*stick_depth + offset_y
        pt = Point(x * grid_size_x, grid_size, z * grid_size_z)
        row.append(pt)
    points.append(row)




### make this like it is a class
### function of the class: to planarize all the points 
pol_pt = []
polylines = []

for i in range(z_range-1):
    i = i % z_range
    pol_points = []
    for j in range(x_range-1):
        j = j % x_range
        p0 = points[i][j]
        p1 = points[i][j+1]
        p3 = points[i+1][j]
        p2 = points[i+1][j+1]
        pol_points.append([p0, p1, p2, p3, p0])
    
    pol_pt.append(pol_points)

for p_list in pol_pt:
    for p in p_list:
        pol = Polyline(p)
        polylines.append(pol)


my_points = list_to_tree(points)


# sticks = [s.geometry for s in assembly]
# ---------- end py3_7 ----------
points_2 = PointList(Points=py3_3.my_points, Size="1")
pt_2 = Point(py3_3.centroids)
points_3 = PointList(Points=py3_6.my_points, Size=panel_2)  # disabled
pt_3 = Point(py3_6.centroids)  # disabled
preview = CustomPreview(
    Geometry=draw_4,
    Material={diffuse=RGB(221, 160, 221), emission=RGB(66, 48, 66), shine=0.5, specular=RGB(255, 255, 255), transparency=0})
deplane = DeconstructPlane(Plane=pln)  # -> Origin, XAxis, YAxis, ZAxis
deplane_2 = DeconstructPlane(Plane=pln_2)  # -> Origin, XAxis, YAxis, ZAxis; disabled
material = CreateMaterial(Diffuse=ColourSwatch(SwatchColor=RGB(0, 0, 0)), Specular=swatch, Emission=swatch, Transparency=0, Shine=0)
vdis = VectorDisplay(Anchor=pt_2, Vector=py3_3.my_vectors)
vdis_2 = VectorDisplay(Anchor=pt_3, Vector=py3_6.my_vectors)  # disabled
vdis_3 = VectorDisplay(Anchor=deplane.Origin, Vector=deplane.XAxis)
vdis_4 = VectorDisplay(Anchor=deplane_2.Origin, Vector=deplane_2.XAxis)  # disabled
draw_6 = COMPASDraw(cg=py3_7.my_points)  # -> rg; disabled; same code as draw
draw_7 = COMPASDraw(cg=py3_7.polylines)  # -> rg; disabled; same code as draw
preview_2 = CustomPreview(Geometry=draw, Material=material)
panel_3 = Panel("1")  # disabled
draw_8 = COMPASDraw(cg=py3_7.sticks)  # -> rg; disabled; same code as draw
points_4 = PointList(Points=draw_6, Size=panel_3)  # disabled
swatch_2 = ColourSwatch(SwatchColor=RGB(0, 0, 0))  # disabled
swatch_3 = ColourSwatch(SwatchColor=RGB(255, 255, 255))  # disabled
material_2 = CreateMaterial(Diffuse=swatch_2, Specular=swatch_3, Emission=swatch_3, Transparency=0, Shine=0)  # disabled
preview_3 = CustomPreview(Geometry=draw_8, Material=material_2)  # disabled
