# Grasshopper definition Root_Frames_&_Bridges.gh (Grasshopper 1.0.8)
# plug-ins: Telepathy

# ---- group: LEGACY CODE
bridging = Python3Script()  # -> out, bridge_mode_A, bridge_mode_B, bridge_mode_C, gh_ghost_A, gh_ghost_B, gh_ghost_C, bridge_frames; inputs layered_sticks: list, mode: String, angle: String; disabled
# ---------- bridging: Python ----------
import Rhino.Geometry as rg
import math

# ======================================================
# PARAMETERS (LOCKED / SAFE DEFAULTS)
# ======================================================
BOX_W = 13.0
BOX_D = 13.0
OVERLAP = 0.05

MAX_BEND_DEG = angle if angle is not None else 150.0
max_distance = max_distance if max_distance is not None else 275.0
mode = mode if mode is not None else "ALL"

layered_sticks = layered_sticks if layered_sticks is not None else []

# ======================================================
# OUTPUT BUFFERS
# ======================================================
bridge_mode_A = []
bridge_mode_B = []
bridge_mode_C = []

gh_ghost_A = []
gh_ghost_B = []
gh_ghost_C = []

bridge_frames = []

# ======================================================
# BASIC HELPERS
# ======================================================
def unit(v):
    if v is None or v.Length < 1e-6:
        return None
    v.Unitize()
    return v

def angle_deg(v1, v2):
    return math.degrees(rg.Vector3d.VectorAngle(v1, v2))

def make_box(Fa, Fb):
    v = Fb.Origin - Fa.Origin
    L = v.Length
    if L < 1e-6:
        return None

    x = unit(rg.Vector3d(v))
    if x is None:
        return None

    y = rg.Vector3d(Fa.YAxis)
    y = y - x * (x * y)
    if y.Length < 1e-6:
        y = rg.Vector3d(Fa.ZAxis)   # ← fallback ONLY
        y = y - x * (x * y)
    y = unit(y)
    if y is None:
        return None


    pl = rg.Plane(Fa.Origin, x, y)
    box = rg.Box(
        pl,
        rg.Interval(0, L),
        rg.Interval(-BOX_W/2, BOX_W/2),
        rg.Interval(-BOX_D/2, BOX_D/2)
    )
    return box.ToBrep()

# ======================================================
# BEND POINT (POINT ONLY)
# ======================================================
def compute_bend(S, T, surf_plane):
    chord = T - S
    d = chord.Length
    if d < 1e-6:
        return None

    u = unit(rg.Vector3d(chord))
    n = unit(rg.Vector3d(surf_plane.ZAxis))
    v = unit(rg.Vector3d.CrossProduct(n, u))

    if u is None or n is None or v is None:
        return None

    M = rg.Point3d(
        0.5*(S.X+T.X),
        0.5*(S.Y+T.Y),
        0.5*(S.Z+T.Z)
    )

    h = (d*0.5) / math.tan(math.radians(MAX_BEND_DEG/2))

    for sign in (1.0, -1.0):
        B = M + v * (sign * h)
        a = angle_deg(S-B, T-B)
        if a <= MAX_BEND_DEG:
            return B

    return None

# ======================================================
# DIAGNOSTIC HEADER
# ======================================================
print("BRIDGE DEBUG")
print("Layers:", len(layered_sticks))
print("Mode:", mode)
print("MaxDist:", max_distance)
print("MaxBend:", MAX_BEND_DEG)

# ======================================================
# MODE A — FIXED FRAME SELECTION
# ======================================================
for layer in layered_sticks:

    group_Y = layer.get("Y", {})
    group_Z = layer.get("Z", {})

    sticks_Y = group_Y.get("sticks", [])
    sticks_Z = group_Z.get("sticks", [])

    if not sticks_Y or not sticks_Z:
        continue

    # ---- LAST CHILD MID FRAMES ----
    sy = sticks_Y[-1]
    sz = sticks_Z[-1]

    if not isinstance(sy.geometry, rg.Box):
        continue
    if not isinstance(sz.geometry, rg.Box):
        continue

    plY = sy.geometry.Plane
    plZ = sz.geometry.Plane

    # SAME SURFACE ONLY
    if abs(plY.DistanceTo(plZ.Origin)) > 1.0:
        continue

    def mid_frame(stick):
        g = stick.geometry
        pl = g.Plane
        xmid = 0.5 * (g.X.T0 + g.X.T1)
        origin = pl.Origin + pl.XAxis * xmid
        return rg.Plane(origin, pl.XAxis, pl.YAxis)

    Fs = mid_frame(sy)
    Ft = mid_frame(sz)

    gh_ghost_A.append(rg.Line(Fs.Origin, Ft.Origin))

    d = Fs.Origin.DistanceTo(Ft.Origin)

    if d <= max_distance:
        brep = make_box(Fs, Ft)
        if brep:
            bridge_mode_A.append(brep)
            bridge_frames.extend([Fs, Ft])
    else:
        Bp = compute_bend(Fs.Origin, Ft.Origin, plY)
        if not Bp:
            continue

        Fb = rg.Plane(Bp, Fs.XAxis, Fs.YAxis)

        for F0, F1 in ((Fs, Fb), (Fb, Ft)):
            brep = make_box(F0, F1)
            if brep:
                bridge_mode_A.append(brep)
                bridge_frames.extend([F0, F1])

print("A:", len(bridge_mode_A), "B:", len(bridge_mode_B), "C:", len(bridge_mode_C))
# ---------- end bridging ----------
bridging_2 = Python3Script()  # -> out, bridge_mode_A, bridge_mode_B, bridge_mode_C, gh_ghost_A, gh_ghost_B, gh_ghost_C, bridge_frames; disabled
bridging_3 = Python3Script()  # -> out, bridge_mode_A, bridge_mode_B, bridge_mode_C, gh_ghost_A, gh_ghost_B, gh_ghost_C, bridge_frames; disabled
bridging_4 = Python3Script()  # -> out, bridge_mode_A, bridge_mode_B, bridge_mode_C, gh_ghost_A, gh_ghost_B, gh_ghost_C, bridge_frames; disabled
swatch = ColourSwatch(SwatchColor=RGB(217, 62, 189))
swatch_2 = ColourSwatch(SwatchColor=RGB(217, 62, 189))
swatch_3 = ColourSwatch(SwatchColor=RGB(217, 62, 189))
swatch_4 = ColourSwatch(SwatchColor=RGB(217, 62, 189))

# ---- group: SAMPLING+BRANCHING
number_slider = Slider(200, range=0..250)
geo = Geometry([<surface referenced from the Rhino model> x2])
gen_rhplanes = Python3Script(
    surface=geo,
    point_density=Slider(300, range=0..500),
    point_randomness=Slider(1, range=0..1),
    min_stick_length=number_slider)  # -> out, list_pts, rootplanes, plane_geos; inputs surface: Surface, point_density: Int32, point_randomness: Double, min_stick_length: Int32
# ---------- gen_rhplanes: Python ----------
import Rhino.Geometry as rg
import random


# INPUT VALIDATION

if surface is None or not isinstance(surface, rg.Surface):
    raise ValueError("Input 'surface' must be a Rhino.Geometry.Surface")

if point_density is None or point_density < 2:
    raise ValueError("sample_density must be >= 2")

if point_density is None or point_density < 1:
    point_density = 25

if point_randomness is None:
    point_randomness = 1.0

# PARAMETERS


min_spacing = 1.5 * min_stick_length
edge_offset = 0.4 * min_stick_length


# UV GRID (CONTROLLED BY sample_density)


u_dom = surface.Domain(0)
v_dom = surface.Domain(1)

u_len = u_dom.Length
v_len = v_dom.Length

# normalized buffer (edge inset)
u_buf = edge_offset / u_len if u_len > 0 else 0.0
v_buf = edge_offset / v_len if v_len > 0 else 0.0

u_count = int(point_density)
v_count = int(point_density)

uv_candidates = []

for i in range(u_count + 1):
    for j in range(v_count + 1):

        u = u_dom.T0 + u_len * (i / float(u_count))
        v = v_dom.T0 + v_len * (j / float(v_count))

        u_n = (u - u_dom.T0) / u_len
        v_n = (v - v_dom.T0) / v_len

        # trim away edges
        if u_n <= u_buf or u_n >= 1.0 - u_buf:
            continue
        if v_n <= v_buf or v_n >= 1.0 - v_buf:
            continue

        uv_candidates.append((u, v))


# RANDOMIZED SAMPLING (SOFT FILTERS)

random.shuffle(uv_candidates)

accepted_pts = []
accepted_planes = []
rejected_pts = []

for (u, v) in uv_candidates:

    if len(accepted_pts) >= point_density:
        break

    # randomness gate 
    if random.random() > point_randomness:
        rejected_pts.append(surface.PointAt(u, v))
        continue

    pt = surface.PointAt(u, v)
    normal = surface.NormalAt(u, v)

    if not normal.IsValid or normal.Length < 1e-6:
        rejected_pts.append(pt)
        continue

    # soft spacing penalty
    too_close = False
    for p in accepted_pts:
        if pt.DistanceTo(p) < min_spacing * random.uniform(0.4, .8):
            too_close = True
            break

    if too_close:
        rejected_pts.append(pt)
        continue

    plane = rg.Plane(pt, normal)

    accepted_pts.append(pt)
    accepted_planes.append(plane)


# PLANE AXIS PREVIEW


plane_geos = []
axis_len = 0.25 * min_stick_length

for pl in accepted_planes:
    o = pl.Origin
    plane_geos.append(rg.Line(o, o + pl.XAxis * axis_len))
    plane_geos.append(rg.Line(o, o + pl.YAxis * axis_len))
    plane_geos.append(rg.Line(o, o + pl.ZAxis * axis_len))


# OUTPUTS


list_pts = accepted_pts
rootplanes = accepted_planes
plane_geos = plane_geos
rejected_pts = rejected_pts
# ---------- end gen_rhplanes ----------
rhplanes_to_frames = Python3Script(rootplanes=flatten(gen_rhplanes.rootplanes), source_surfaces=geo, stick_length=number_slider)  # -> out, paired_root_frames, paired_origins, family_labels_output, growth_directions_rg, direction_lines, qa_visual_tags, qa_visual_roots; inputs rootplanes: list of Plane, source_surfaces: list of Surface, stick_length: Int32
# ---------- rhplanes_to_frames: Python ----------
import Rhino.Geometry as rg
from compas.geometry import Frame, Point, Vector, distance_point_point
from Grasshopper import DataTree
from Grasshopper.Kernel.Data import GH_Path
from collections import defaultdict

# ------------------------------------------------------------
# VALIDATE INPUTS
# ------------------------------------------------------------

if not source_surfaces or not rootplanes:
    raise ValueError("Missing input surfaces or planes.")

# ------------------------------------------------------------
# ASSIGN EACH PLANE TO CLOSEST SURFACE
# ------------------------------------------------------------

plane_surface_ids = []

for pl in rootplanes:
    pt = pl.Origin
    closest_sid = None
    closest_dist = float("inf")

    for sid, surf in enumerate(source_surfaces):
        ok, surf_plane = surf.TryGetPlane()
        if not ok:
            continue

        d = abs(surf_plane.DistanceTo(pt))
        if d < closest_dist:
            closest_dist = d
            closest_sid = sid

    plane_surface_ids.append(closest_sid)

# ------------------------------------------------------------
# ASSIGN FAMILIES (Y/Z) PER SURFACE
# ------------------------------------------------------------

surface_plane_indices = defaultdict(list)
for i, sid in enumerate(plane_surface_ids):
    surface_plane_indices[sid].append(i)

family_labels = [None] * len(rootplanes)
for sid, indices in surface_plane_indices.items():
    for j, i in enumerate(indices):
        family_labels[i] = "Y" if j % 2 == 0 else "Z"

# ------------------------------------------------------------
# SURFACE TYPES
# ------------------------------------------------------------

surface_types = {
    0: "outer",
    1: "outer",
    2: "inner",
    3: "inner"
}

# ------------------------------------------------------------
# BUILD STRUCTURED GROUPS
# ------------------------------------------------------------

structured = {}

for i, pl in enumerate(rootplanes):
    if not isinstance(pl, rg.Plane):
        continue

    frame = Frame(
        Point(pl.Origin.X, pl.Origin.Y, pl.Origin.Z),
        Vector(pl.XAxis.X, pl.XAxis.Y, pl.XAxis.Z),
        Vector(pl.YAxis.X, pl.YAxis.Y, pl.YAxis.Z),
    )

    sid = plane_surface_ids[i]
    fam = family_labels[i]

    key = (sid, fam)
    structured.setdefault(
        key,
        {"surface_id": sid, "family": fam, "type": surface_types.get(sid, "outer"), "frames": []},
    )["frames"].append(frame)

# ------------------------------------------------------------
# PAIRING LOGIC (FIXED)
# ------------------------------------------------------------

paired = []  # ← AUTHORITATIVE LIST

for group in structured.values():
    frames = group["frames"]
    surface_type = group["type"]
    sid = group["surface_id"]

    if len(frames) < 2:
        continue

    frames = sorted(frames, key=lambda f: f.point.z)

    for root in frames:
        root_pt = root.point
        closest = None
        min_dist = float("inf")

        for f in frames:
            if f is root:
                continue

            dz = f.point.z - root_pt.z
            if surface_type == "outer" and dz <= 0:
                continue
            if surface_type == "inner" and dz >= 0:
                continue

            d = distance_point_point(root_pt, f.point)
            if d < min_dist:
                closest = f
                min_dist = d

        if not closest:
            continue

        direction = closest.point - root_pt
        normal = root.normal
        direction_proj = (direction - direction.dot(normal) * normal).unitized()

        new_frame = Frame(
            root_pt,
            direction_proj,
            normal.cross(direction_proj).unitized()
        )

        # ✅ THIS WAS MISSING
        paired.append((sid, new_frame, direction_proj))

# ------------------------------------------------------------
# BUILD GRASSHOPPER DATATREES (ONCE)
# ------------------------------------------------------------

paired_root_frames = DataTree[object]()
growth_directions_rg = DataTree[object]()

by_surface = defaultdict(list)
for sid, frame, vec in paired:
    if not isinstance(vec, Vector):
        raise TypeError(f"Invalid growth vector upstream: {type(vec)}")
    by_surface[sid].append((frame, vec))

for sid, items in by_surface.items():
    path = GH_Path(sid)
    for frame, vec in items:
        paired_root_frames.Add(frame, path)
        growth_directions_rg.Add(rg.Vector3d(vec.x, vec.y, vec.z), path)

# ------------------------------------------------------------
# DEBUG
# ------------------------------------------------------------

debug = []
for i in range(growth_directions_rg.BranchCount):
    debug.append(
        f"Surface {i}: {len(growth_directions_rg.Branch(i))} vectors"
    )

debug
# ---------- end rhplanes_to_frames ----------
panel = Panel(gen_rhplanes.list_pts)
panel_2 = Panel(rhplanes_to_frames.family_labels_output)
geo_2 = Geometry(rhplanes_to_frames.qa_visual_roots)
draw = COMPASDraw(cg=rhplanes_to_frames.paired_root_frames)  # -> rg
#   port cg: The COMPAS geometry or datastructure to be drawn.
#   port rg: The Rhino geometry object.
# ---------- draw: Python ----------
# r: compas>=2.14.1
"""
Draws COMPAS geometry in Grasshopper.
"""

from typing import Any

import Grasshopper

from compas.scene import SceneObject


class CompasToRhinoGeometry(Grasshopper.Kernel.GH_ScriptInstance):
    def RunScript(self, cg):
        if not cg:
            return None

        return SceneObject(item=cg).draw()
# ---------- end draw ----------
swatch_5 = ColourSwatch(SwatchColor=RGB(0, 0, 250))
preview = CustomPreview(Geometry=rhplanes_to_frames.direction_lines, Material=swatch_5)
tag = TextTag(Location=rhplanes_to_frames.paired_origins, Text=rhplanes_to_frames.family_labels_output, Colour=swatch_5)
branching = Python3Script(
    surface=geo,
    paired_root_frames=rhplanes_to_frames.paired_root_frames,
    family_labels_output=rhplanes_to_frames.family_labels_output,
    direction_lines=rhplanes_to_frames.direction_lines,
    growth_directions_rg=rhplanes_to_frames.growth_directions_rg,
    stick_angle=Slider(60, range=0..90),
    offset=Slider(15, range=0..200))  # -> out, parent_frames, geometries, layered_sticks, axes, flat_sticks; inputs surface: Surface, paired_root_frames: tree, family_labels_output: list of String, direction_lines: list, growth_directions_rg: tree of Vector3d, stick_angle: Int32, offset: Int32
# ---------- branching: Python ----------
import sys
import os
import math
import traceback
import Rhino.Geometry as rg

# ============================================================
# SETUP
# ============================================================

path = ghenv.Component.OnPingDocument().FilePath
parentdir = os.path.dirname(path) if path else ""
scripts_dir = os.path.join(parentdir, "scripts") if parentdir else ""

if scripts_dir and scripts_dir not in sys.path:
    sys.path.append(scripts_dir)

from compas.geometry import Frame, Vector, Point
from compas_rhino import unload_modules
from branch import BranchingModule

unload_modules("branch")

# ============================================================
# OPTION B — HARD SURFACE TOPOLOGY (LOCKED)
# ============================================================

# Adjust ONLY this if needed
SURFACE_BINS = [
    (0, 3),   # indices [0–2]
    (1, 6),   # indices [3–5]
    (2, 8),   # indices [6–7]
    (3, 10),  # indices [8–9]
]

def surface_id_from_index(i):
    for sid, upper in SURFACE_BINS:
        if i < upper:
            return sid
    return SURFACE_BINS[-1][0]

surface_types = {
    0: "outer",
    1: "outer",
    2: "inner",
    3: "inner"
}

# ============================================================
# CONSTANTS
# ============================================================

stick_length = 150.0
stick_width  = 13.0
stick_depth  = 13.0
stick_angle  = stick_angle if "stick_angle" in globals() else 35.0
offset       = offset if "offset" in globals() else 20.0

ANGLE_STEPS = [0, -15, -30, -45, -60, -75, -90]

# ============================================================
# TYPE-SAFE HELPERS
# ============================================================

def to_compas_vector(v):
    if isinstance(v, Vector):
        return v
    if hasattr(v, "X") and hasattr(v, "Y") and hasattr(v, "Z"):
        return Vector(v.X, v.Y, v.Z)
    raise TypeError(f"Invalid growth vector: {type(v)} → {v}")

def promote_to_frame(root, vec):
    if isinstance(root, Frame):
        return root
    if isinstance(root, Point):
        xaxis = vec.unitized()
        up = Vector(0, 0, 1)
        if abs(xaxis.dot(up)) > 0.95:
            up = Vector(0, 1, 0)
        yaxis = up.cross(xaxis).unitized()
        return Frame(root, xaxis, yaxis)
    raise TypeError(f"Invalid root type: {type(root)}")

def group_by_height(items, h=125.0):
    if not items:
        return []
    layers, current = [], []
    z0 = items[0][0].point.z
    for item in items:
        z = item[0].point.z
        if z - z0 < h:
            current.append(item)
        else:
            layers.append(current)
            current = [item]
            z0 = z
    if current:
        layers.append(current)
    return layers

# ============================================================
# CORE GROWTH
# ============================================================

def grow_group(group, face_index, surface_id, surface_type, layer_id, family, pool):
    for frame_index, (root_frame, vec, _, _) in enumerate(group):

        xaxis = vec.unitized()
        ref = root_frame.zaxis if abs(xaxis.dot(root_frame.zaxis)) < 0.95 else root_frame.yaxis
        yaxis = ref.cross(xaxis).unitized()
        zaxis = xaxis.cross(yaxis).unitized()

        base_point = root_frame.point - xaxis * (0.1 * stick_length)
        base_frame = Frame(base_point, xaxis, yaxis)

        best_tree = None

        for a in ANGLE_STEPS:
            f = base_frame.copy()
            f.rotate(math.radians(a), zaxis)

            tree = BranchingModule(
                f,
                stick_length=stick_length,
                width=stick_width,
                depth=stick_depth
            )

            tree.grow_stick(
                from_stick_index=0,
                face_index=face_index,
                angle=stick_angle,
                offset=offset
            )

            if len(tree.sticks) >= 2:
                best_tree = tree
                break

        if not best_tree:
            continue

        for s in best_tree.sticks:
            s.surface_id   = surface_id
            s.surface_type = surface_type
            s.layer        = layer_id
            s.family       = family
            s.frame_index  = frame_index
            pool.append(s)

# ============================================================
# MAIN
# ============================================================

collision_pool = []
debug_log = []

try:
    # 🔒 FLATTEN INPUTS (NO TREES, NO BRANCHING)
    # ------------------------------------------------------------
    # GH-SAFE FLATTEN (ORDER PRESERVED)
    # ------------------------------------------------------------

    roots = []
    vecs  = []

    for b in range(paired_root_frames.BranchCount):
        roots.extend(list(paired_root_frames.Branch(b)))

    for b in range(growth_directions_rg.BranchCount):
        vecs.extend(list(growth_directions_rg.Branch(b)))


    if len(roots) != len(vecs):
        raise ValueError("Root / vector count mismatch")

    paired = []

    for i, (r, v) in enumerate(zip(roots, vecs)):
        sid = surface_id_from_index(i)
        vec = to_compas_vector(v)
        frame = promote_to_frame(r, vec)
        family = "Y" if i % 2 == 0 else "Z"
        paired.append((frame, vec, family, sid))

    from collections import defaultdict
    by_surface = defaultdict(list)

    for p in paired:
        by_surface[p[3]].append(p)

    for surface_id, items in by_surface.items():
        items.sort(key=lambda p: p[0].point.z)
        layers = group_by_height(items)
        surf_type = surface_types.get(surface_id, "outer")

        for layer_id, layer in enumerate(layers):
            grow_group(
                [i for i in layer if i[2] == "Y"],
                3, surface_id, surf_type, layer_id, "Y", collision_pool
            )
            grow_group(
                [i for i in layer if i[2] == "Z"],
                2, surface_id, surf_type, layer_id, "Z", collision_pool
            )

except Exception:
    print(traceback.format_exc())

# ============================================================
# FINAL INDEXING
# ============================================================

for i, s in enumerate(collision_pool):
    s.index = i

# ============================================================
# OUTPUTS
# ============================================================

flat_sticks = collision_pool
geometries  = [s.geometry for s in collision_pool]
axes        = [s.axis for s in collision_pool]

from collections import Counter
print("STICKS:", len(collision_pool))
print("SURFACE COUNTS:", Counter(s.surface_id for s in collision_pool))
# ---------- end branching ----------
draw_2 = COMPASDraw(cg=branching.geometries)  # -> rg; disabled; same code as draw
preview_2 = CustomPreview(Geometry=branching.flat_sticks, Material=ColourSwatch(SwatchColor=RGB(244, 0, 25)))

# ----
geo_3 = Geometry(gen_rhplanes.list_pts)
preview_3 = CustomPreview(Geometry=gen_rhplanes.plane_geos, Material=ColourSwatch(SwatchColor=RGB(232, 241, 30)))
panel_3 = Panel(branching.flat_sticks)
draw_3 = COMPASDraw(cg=branching.axes)  # -> rg; same code as draw
height_subdiv = Slider(2, range=0..30)  # disabled
twist_angle = Slider(11, range=0..30)  # disabled
max_height = Slider(126, range=0..200)  # disabled
preview_4 = CustomPreview(Geometry=branching.geometries, Material=ColourSwatch(SwatchColor=RGB(226, 220, 207)))
layers = Slider(80, range=0..100)  # disabled

# ---- group: BRIDGING
bridging_mode_b = Python3Script(flat_sticks=branching.flat_sticks, max_distance=Slider(500, range=0..1500), STICK_LENGTH=Slider(250, range=0..500))  # -> out, geometries, debug_lines; inputs flat_sticks: list
# ---------- bridging_mode_b: Python ----------
# ======================================================
# IMPORTS & GH SAFE SETUP
# ======================================================

import sys
import os
import math
import Rhino.Geometry as rg

from compas.geometry import Frame, Line, Vector
from compas_rhino import unload_modules

# ---- PATH SETUP ----
path = ghenv.Component.OnPingDocument().FilePath
parentdir = os.path.dirname(path) if path else ""
scripts_dir = os.path.join(parentdir, "scripts") if parentdir else ""

if scripts_dir and scripts_dir not in sys.path:
    sys.path.append(scripts_dir)

# ---- FORCE RELOAD ----
unload_modules("Sticks")
unload_modules("new_bridge")
unload_modules("stick_bridge")
unload_modules("stick_growth")

from Sticks import Stick
# ======================================================
# MODE A — INTRA-SURFACE
# ======================================================

bridge_sticks = []
debug_lines = []

if not flat_sticks:
    geometries = []
    debug_lines = []

else:
    from collections import defaultdict

    # ---- group sticks by surface ----
    by_surface = defaultdict(list)
    for s in flat_sticks:
        sid = getattr(s, "surface_id", None)
        by_surface[sid].append(s)

    for sid, sticks in by_surface.items():

        # ---- determine last layer ----
        layers = [getattr(s, "layer", None) for s in sticks if hasattr(s, "layer")]
        if not layers:
            continue
        last_layer = max(layers)

        layer_sticks = [
            s for s in sticks
            if getattr(s, "layer", None) == last_layer
        ]

        Y = [s for s in layer_sticks if getattr(s, "family", None) == "Y"]
        Z = [s for s in layer_sticks if getattr(s, "family", None) == "Z"]

        pair_count = min(len(Y), len(Z))

        for i in range(pair_count):
            sA = Y[i]
            sB = Z[i]

            # ---- mid frames (API-correct) ----
            fA = sA.frame.copy()
            fA.point = sA.axis.start + fA.xaxis * (0.5 * sA.axis.length)

            fB = sB.frame.copy()
            fB.point = sB.axis.start + fB.xaxis * (0.5 * sB.axis.length)

            # ---- provisional straight bridge ----
            direction = Vector.from_start_end(fA.point, fB.point).unitized()
            axis = Line.from_point_and_vector(
                fA.point,
                direction * sA.axis.length
            )

            bridge = Stick(axis, fA.yaxis)
            bridge_sticks.append(bridge)

            debug_lines.append(
                rg.Line(
                    rg.Point3d(fA.point.x, fA.point.y, fA.point.z),
                    rg.Point3d(fB.point.x, fB.point.y, fB.point.z),
                )
            )

geometries = [s.geometry for s in bridge_sticks]
# ---------- end bridging_mode_b ----------
panel_4 = Panel(bridging_mode_b.geometries)
bridging_mode_a = Python3Script(flat_sticks=branching.flat_sticks, max_distance=Slider(500, range=0..1500), STICK_LENGTH=Slider(250, range=0..500))  # -> out, geometries, debug_lines; inputs flat_sticks: list
# ---------- bridging_mode_a: Python ----------
# IMPORTS & GH SAFE SETUP


import sys
import os
import math
import Rhino.Geometry as rg

from compas.geometry import Frame, Line, Vector
from compas_rhino import unload_modules

#  PATH SETUP
path = ghenv.Component.OnPingDocument().FilePath
parentdir = os.path.dirname(path) if path else ""
scripts_dir = os.path.join(parentdir, "scripts") if parentdir else ""

if scripts_dir and scripts_dir not in sys.path:
    sys.path.append(scripts_dir)

# FORCE RELOAD 
unload_modules("Sticks")
unload_modules("new_bridge")
unload_modules("stick_bridge")
unload_modules("stick_growth")

from Sticks import Stick



# MODE A — INTRA-SURFACE


bridge_sticks = []
debug_lines = []

if not flat_sticks:
    geometries = []
    debug_lines = []

else:
    from collections import defaultdict

    # ---- group sticks by surface ----
    by_surface = defaultdict(list)
    for s in flat_sticks:
        sid = getattr(s, "surface_id", None)
        by_surface[sid].append(s)

    for sid, sticks in by_surface.items():

        # ---- determine last layer ----
        layers = [getattr(s, "layer", None) for s in sticks if hasattr(s, "layer")]
        if not layers:
            continue
        last_layer = max(layers)

        layer_sticks = [
            s for s in sticks
            if getattr(s, "layer", None) == last_layer
        ]

        Y = [s for s in layer_sticks if getattr(s, "family", None) == "Y"]
        Z = [s for s in layer_sticks if getattr(s, "family", None) == "Z"]

        pair_count = min(len(Y), len(Z))

        for i in range(pair_count):
            sA = Y[i]
            sB = Z[i]

            # ---- mid frames (API-correct) ----
            fA = sA.frame.copy()
            fA.point = sA.axis.start + fA.xaxis * (0.5 * sA.axis.length)

            fB = sB.frame.copy()
            fB.point = sB.axis.start + fB.xaxis * (0.5 * sB.axis.length)

            # ---- provisional straight bridge ----
            direction = Vector.from_start_end(fA.point, fB.point).unitized()
            axis = Line.from_point_and_vector(
                fA.point,
                direction * sA.axis.length
            )

            bridge = Stick(axis, fA.yaxis)
            bridge_sticks.append(bridge)

            debug_lines.append(
                rg.Line(
                    rg.Point3d(fA.point.x, fA.point.y, fA.point.z),
                    rg.Point3d(fB.point.x, fB.point.y, fB.point.z),
                )
            )

geometries = [s.geometry for s in bridge_sticks]
# ---------- end bridging_mode_a ----------
panel_5 = Panel(bridging_mode_a.geometries)
bridging_mode_a_2 = Python3Script(flat_sticks=branching.flat_sticks, max_distance=Slider(500, range=0..1500), STICK_LENGTH=Slider(250, range=0..500))  # -> out, geometries, debug_lines; inputs flat_sticks: list
# ---------- bridging_mode_a_2: Python ----------
# ======================================================
# MODE C — ADJACENT SURFACES (SAME TYPE), CLOSEST PAIR ONLY
# ======================================================

import sys
import os
import math
import Rhino.Geometry as rg

from compas.geometry import Point, Vector, Line
from compas_rhino import unload_modules

# ---- PATH SETUP ----
path = ghenv.Component.OnPingDocument().FilePath
parentdir = os.path.dirname(path) if path else ""
scripts_dir = os.path.join(parentdir, "scripts") if parentdir else ""
if scripts_dir and scripts_dir not in sys.path:
    sys.path.append(scripts_dir)

# ---- FORCE RELOAD ----
unload_modules("Sticks")
try:
    from Sticks import Stick
except Exception as e:
    raise ImportError("Could not import Stick from Sticks module")

# --------------------------
# USER PARAMETERS (safe)
# --------------------------
max_distance = max_distance if "max_distance" in globals() and max_distance is not None else 600.0
inset_ratio  = inset_ratio  if "inset_ratio"  in globals() and inset_ratio  is not None else 0.10

# Your fixed topology (from branch script)
SURFACE_TYPE_MAP = {
    0: "outer",
    1: "outer",
    2: "inner",
    3: "inner"
}

# Adjacent pairs of SAME type
ADJACENT_PAIRS = [(0, 1), (2, 3)]

# --------------------------
# GH SAFE NORMALIZE
# --------------------------
def normalize_sticks(x):
    if x is None:
        return []
    # DataTree
    if hasattr(x, "BranchCount") and hasattr(x, "Branch"):
        out = []
        for b in range(x.BranchCount):
            out.extend(list(x.Branch(b)))
        return out
    # Single stick
    if not isinstance(x, (list, tuple)):
        return [x]
    return list(x)

sticks = normalize_sticks(flat_sticks)

bridge_sticks = []
debug_lines = []
info = []

if not sticks:
    geometries = []
    info = ["Mode C: flat_sticks is empty"]
else:
    # --------------------------
    # Helpers
    # --------------------------
    def compas_midpoint(stick):
        """Return compas Point at axis midpoint."""
        a = stick.axis
        sp = a.start
        ep = a.end
        return Point(
            0.5 * (sp.x + ep.x),
            0.5 * (sp.y + ep.y),
            0.5 * (sp.z + ep.z),
        )

    def compas_length(stick):
        a = stick.axis
        sp, ep = a.start, a.end
        dx = ep.x - sp.x
        dy = ep.y - sp.y
        dz = ep.z - sp.z
        return math.sqrt(dx*dx + dy*dy + dz*dz)

    def rh_line(pA, pB):
        return rg.Line(
            rg.Point3d(pA.x, pA.y, pA.z),
            rg.Point3d(pB.x, pB.y, pB.z)
        )

    # --------------------------
    # Group sticks by surface
    # --------------------------
    from collections import defaultdict
    by_surface = defaultdict(list)
    for s in sticks:
        sid = getattr(s, "surface_id", None)
        if sid is None:
            continue
        by_surface[int(sid)].append(s)

    info.append(f"Mode C | max_distance={max_distance} | inset_ratio={inset_ratio}")
    info.append("Surface counts: " + str({k: len(v) for k, v in by_surface.items()}))

    # --------------------------
    # Candidate selection (flexible layers)
    # start with last layer only; expand down if needed
    # --------------------------
    def candidates_last_layers(sticks_on_surface, expand_layers=0):
        """
        expand_layers=0 => only last layer
        expand_layers=1 => last + one below
        etc.
        """
        if not sticks_on_surface:
            return []
        layers = sorted(set(getattr(s, "layer", 0) for s in sticks_on_surface))
        if not layers:
            return sticks_on_surface
        # take highest N layers
        take = layers[-(1 + expand_layers):]
        return [s for s in sticks_on_surface if getattr(s, "layer", 0) in take]

    # --------------------------
    # Build ONE closest bridge per adjacent pair
    # --------------------------
    for (sid_a, sid_b) in ADJACENT_PAIRS:

        type_a = SURFACE_TYPE_MAP.get(sid_a)
        type_b = SURFACE_TYPE_MAP.get(sid_b)

        # Safety: enforce same-type pairs only
        if type_a != type_b:
            info.append(f"SKIP pair ({sid_a},{sid_b}) — types differ ({type_a},{type_b})")
            continue

        SA = by_surface.get(sid_a, [])
        SB = by_surface.get(sid_b, [])

        if not SA or not SB:
            info.append(f"SKIP pair ({sid_a},{sid_b}) — missing sticks")
            continue

        best = None
        best_d = float("inf")

        # try last-layer only, then expand search if nothing within max_distance
        found = False
        for expand in (0, 1, 2):  # adjust later if needed
            candA = candidates_last_layers(SA, expand_layers=expand)
            candB = candidates_last_layers(SB, expand_layers=expand)

            best = None
            best_d = float("inf")

            for a in candA:
                pA = compas_midpoint(a)
                for b in candB:
                    pB = compas_midpoint(b)

                    d = pA.distance_to_point(pB)
                    if d < best_d:
                        best_d = d
                        best = (a, b, pA, pB, expand)

            if best and best_d <= max_distance:
                found = True
                break

        if not found or not best:
            info.append(f"REJECT pair ({sid_a},{sid_b}) — no candidate within max_distance (best={best_d:.2f})")
            continue

        a, b, pA, pB, used_expand = best
        info.append(f"PAIR ({sid_a},{sid_b}) type={type_a} | dist={best_d:.2f} | expand_layers={used_expand}")

        # Build single straight bridge Stick with inset at both ends
        dir_vec = Vector.from_start_end(pA, pB)
        dlen = dir_vec.length
        if dlen < 1e-6:
            info.append(f"SKIP ({sid_a},{sid_b}) — degenerate distance")
            continue

        dir_unit = dir_vec.unitized()

        # inset is fraction of *branch stick length* (use source stick length as baseline)
        Lsrc = compas_length(a)
        inset = inset_ratio * Lsrc

        p0 = pA + dir_unit * inset
        p1 = pB - dir_unit * inset

        span_vec = Vector.from_start_end(p0, p1)
        if span_vec.length < 1e-6:
            info.append(f"SKIP ({sid_a},{sid_b}) — inset collapses span")
            continue

        axis = Line(p0, p1)

        # lock "no twist": use source stick's frame yaxis as z_vector input
        zvec = a.frame.yaxis if hasattr(a, "frame") else Vector(0, 0, 1)

        br = Stick(axis, zvec)
        _ = br.geometry  # force brep generation

        # attach metadata for debugging
        br.mode = "C"
        br.surface_pair = (sid_a, sid_b)
        br.source_index = getattr(a, "index", None)
        br.target_index = getattr(b, "index", None)

        bridge_sticks.append(br)

        # debug
        debug_lines.append(rh_line(pA, pB))
        debug_lines.append(rh_line(p0, p1))

# --------------------------
# OUTPUTS
# --------------------------
geometries = [s.geometry for s in bridge_sticks]
# keep debug_lines as-is
info = "\n".join(info)
# ---------- end bridging_mode_a_2 ----------
panel_6 = Panel(bridging_mode_a_2.geometries)
preview_5 = CustomPreview(Geometry=bridging_mode_b.geometries, Material=ColourSwatch(SwatchColor=RGB(115, 133, 187)))
preview_6 = CustomPreview(Geometry=bridging_mode_a.geometries, Material=ColourSwatch(SwatchColor=RGB(222, 15, 187)))
swatch_6 = ColourSwatch(SwatchColor=RGB(240, 243, 39))  # disabled
preview_7 = CustomPreview(Geometry=bridging_mode_a_2.geometries, Material=swatch_6)

# ----
midpt = CurveMiddle(Curve=draw_3)
points = PointList(Points=midpt, Size=Slider(33, range=0..100))
crv = Curve(<curve referenced from the Rhino model>)  # disabled

# ---- group: STICK_METADATA
surface_lists = Python3Script(rootplanes=gen_rhplanes.rootplanes)  # -> out, Surfaces, index_dots, local_planes; inputs rootplanes: tree of Plane
# ---------- surface_lists: Python ----------
from Grasshopper import DataTree
from Grasshopper.Kernel.Data import GH_Path
import Rhino.Geometry as rg


planes_by_surface = []

for i in range(rootplanes.BranchCount):
    branch = rootplanes.Branch(i)
    planes_by_surface.append(list(branch))



Surf_1 = planes_by_surface[0] if rootplanes.BranchCount > 0 else []
Surf_2 = planes_by_surface[1] if rootplanes.BranchCount > 1 else []
Surf_3 = planes_by_surface[2] if rootplanes.BranchCount > 2 else []
Surf_4 = planes_by_surface[3] if rootplanes.BranchCount > 3 else []

#group YZ per surface

Surf_0 = {
    "Y": [],
    "Z": []
}

def split_YZ(planes):
    Y = []
    Z = []
    for i, pl in enumerate(planes):
        if i % 2 == 0:
            Y.append(pl)
        else:
            Z.append(pl)
    return {"Y": Y, "Z": Z}

Surf_1 = split_YZ(Surf_1)
Surf_2 = split_YZ(Surf_2)
Surf_3 = split_YZ(Surf_3)
Surf_4 = split_YZ(Surf_4)

Surfaces = {
    0: split_YZ(Surf_1),
    1: split_YZ(Surf_2),
    2: split_YZ(Surf_3),
    3: split_YZ(Surf_4),
}

# visuals



index_dots = []

def label_planes(surf_id, surf_dict):
    dots = []

    for fam in ["Y", "Z"]:
        planes = surf_dict[fam]
        for i, pl in enumerate(planes):
            pt = pl.Origin
            text = f"S{surf_id} | {fam} | {i}"
            dot = rg.TextDot(text, pt)
            dots.append(dot)

    return dots

index_dots.extend(label_planes(1, Surf_1))
index_dots.extend(label_planes(2, Surf_2))
index_dots.extend(label_planes(3, Surf_3))
index_dots.extend(label_planes(4, Surf_4))

# local planes
local_planes = []

for surf_id, surf in enumerate([Surf_1, Surf_2, Surf_3, Surf_4], start=1):
    for fam in ["Y", "Z"]:
        for pl in surf[fam]:
            local_planes.append(
                rg.PlaneSurface(pl, rg.Interval(-10,10), rg.Interval(-10,10))
            )
# ---------- end surface_lists ----------
metadata = Python3Script(flat_sticks=branching.flat_sticks, Surfaces=surface_lists.Surfaces, query_index=Slider(0, range=0..10))  # -> out, stick_metadata, info; inputs query_index: Int32
# ---------- metadata: Python ----------
# ----------------------------
# NORMALIZE flat_sticks FIRST
# ----------------------------
if flat_sticks is None:
    flat_sticks = []

elif hasattr(flat_sticks, "BranchCount"):
    sticks = []
    for i in range(flat_sticks.BranchCount):
        sticks.extend(list(flat_sticks.Branch(i)))
    flat_sticks = sticks

elif not isinstance(flat_sticks, list):
    flat_sticks = [flat_sticks]

# ----------------------------
# SAFE DEBUG (after normalize)
# ----------------------------
n = len(flat_sticks)
info = f"len={n} | idx={query_index}"

# ----------------------------
# INSPECT (CLAMPED)
# ----------------------------
if n == 0:
    info = "No sticks yet"

elif query_index is None:
    info = "No index"

else:
    idx = int(query_index)

    # clamp index to valid range
    if idx < 0:
        idx = 0
    if idx >= n:
        idx = n - 1

    s = flat_sticks[idx]
    info = (
        f"Stick #{idx}\n"
        f"Surface ID: {s.surface_id}\n"
        f"Surface Type: {s.surface_type}\n"
        f"Layer: {s.layer}\n"
        f"Family: {s.family}\n"
        f"Frame Index: {s.frame_index}"
    )
# ---------- end metadata ----------
py3 = Python3Script(flat_sticks=branching.flat_sticks)  # -> out, labels, points; inputs flat_sticks: tree
# ---------- py3: Python ----------
import Rhino.Geometry as rg

labels = []
points = []

# ----------------------------
# NORMALIZE flat_sticks
# ----------------------------
if flat_sticks is None:
    flat_sticks = []

elif hasattr(flat_sticks, "BranchCount"):
    sticks = []
    for i in range(flat_sticks.BranchCount):
        sticks.extend(list(flat_sticks.Branch(i)))
    flat_sticks = sticks

elif not isinstance(flat_sticks, list):
    flat_sticks = [flat_sticks]

# ----------------------------
# CREATE INDEX LABELS
# ----------------------------
for i, s in enumerate(flat_sticks):

    # choose a stable point to label
    # prefer frame point, fallback to geometry bbox
    if hasattr(s, "frame") and s.frame:
        pt = rg.Point3d(
            s.frame.point.x,
            s.frame.point.y,
            s.frame.point.z
        )
    elif hasattr(s, "geometry") and s.geometry:
        bbox = s.geometry.GetBoundingBox(True)
        pt = bbox.Center
    else:
        continue

    idx = getattr(s, "index", i)
    dot = rg.TextDot(str(idx), pt)


    labels.append(dot)
    points.append(pt)
# ---------- end py3 ----------
panel_7 = Panel(metadata.info)
preview_8 = CustomPreview(Geometry=surface_lists.index_dots, Material=ColourSwatch(SwatchColor=RGB(124, 171, 255)))

# ---- group: VIZ-AXES
swatch_7 = ColourSwatch(SwatchColor=RGB(0, 255, 0))  # disabled
swatch_8 = ColourSwatch(SwatchColor=RGB(255, 0, 0))  # disabled
swatch_9 = ColourSwatch(SwatchColor=RGB(6, 0, 255))  # disabled

number_slider_2 = Slider(9, range=0..10)  # disabled
py3_2 = Python3Script(frames=rhplanes_to_frames.paired_root_frames, scale=number_slider_2)  # -> out, x_lines, y_lines, z_lines; inputs frames: list, scale: Double; disabled
# ---------- py3_2: Python ----------
import Rhino.Geometry as rg
from compas.geometry import Point, Vector

# Inputs: frames (list[Frame]), scale (float)

x_lines = []
y_lines = []
z_lines = []

for f in frames:
    origin = f.point
    x_end = origin + f.xaxis.scaled(scale)
    y_end = origin + f.yaxis.scaled(scale)
    z_end = origin + f.zaxis.scaled(scale)

    x_lines.append(rg.Line(rg.Point3d(*origin), rg.Point3d(*x_end)))
    y_lines.append(rg.Line(rg.Point3d(*origin), rg.Point3d(*y_end)))
    z_lines.append(rg.Line(rg.Point3d(*origin), rg.Point3d(*z_end)))
# ---------- end py3_2 ----------
preview_9 = CustomPreview(Geometry=py3_2.x_lines, Material=swatch_8)  # disabled
preview_10 = CustomPreview(Geometry=py3_2.y_lines, Material=swatch_7)  # disabled
preview_11 = CustomPreview(Geometry=py3_2.z_lines, Material=swatch_9)  # disabled

# ----
list_pts = RemoteSender()  # disabled
geo_4 = Geometry(list_pts)  # disabled

remote_receiver = RemoteReceiver()  # disabled
panel_8 = Panel(remote_receiver)  # disabled

list_pts_2 = RemoteReceiver(list_pts)  # disabled
